# Grasshopper definition arb_scisor_mechanism.gh (Grasshopper 1.0.7)
# plug-ins: Pufferfish

# ----
# transformed geometry parameters
transformed_preview_offset_vector = Vector(Vector(20.28931872, 0, 0.1166447517))
rescale_factor = Slider(0.801, range=0..1)

# ----
# initial_rhombus_parameters
initial_rhombus_internal_angle = Slider(0, range=0..3.14)

# ----
# link_fabrication_parameters
hole_size = Slider(0.174, range=0..1)
link_width = Slider(0.33, range=0..1)

# ----
# input
curve = Curve(<curve referenced from the Rhino model>)

# ----
# generate_segments
explode = Explode(Curve=curve, Recursive=True)  # -> Segments, Vertices
end_points = EndPoints(Curve=explode.Segments)  # -> Start, End
vector_2pt = Vector2Pt(PointA=end_points.Start, PointB=end_points.End, Unitize=False)  # -> Vector, Length

# ----
# construct_rhombus
internal_angle = Number(initial_rhombus_internal_angle)
cosine = Cosine(Value=internal_angle)
sine = Sine(Value=internal_angle)
_1 = Number(1)
_0 = Number(0)
construct_point = ConstructPoint(XCoordinate=cosine, YCoordinate=sine, ZCoordinate=_0)
construct_point_2 = ConstructPoint(XCoordinate=_1, YCoordinate=_0, ZCoordinate=_0)
origin = ConstructPoint(XCoordinate=_0, YCoordinate=_0, ZCoordinate=_0)
addition = Addition(A=construct_point, B=construct_point_2)
merge = Merge(Data1=origin, Data2=construct_point_2, Data3=addition, Data4=construct_point)
boolean = Boolean(True)
polyline = PolyLine(Vertices=merge, Closed=boolean)

# ----
# rescale
polygon_center = PolygonCenter(Polyline=curve)  # -> CenterV, CenterE, CenterA
# target_configuration_transform
scale = Scale(Geometry=curve, Center=polygon_center.CenterE, Factor=rescale_factor)  # -> Geometry, Transform

# ----
# Create Normal To Curve
explode_2 = Explode(Curve=curve, Recursive=True)  # -> Segments, Vertices
panel = Panel("""1
2
3""")
list_item = ListItem(List=explode_2.Vertices, Index=panel, Wrap=True)  # -> graft(Item)
explode_tree = ExplodeTree(Data=list_item)  # -> Branch0, Branch1, Branch2
plane_3pt = Plane3Pt(PointA=explode_tree.Branch0, PointB=explode_tree.Branch1, PointC=explode_tree.Branch2)

# ----
# select_rhomb_vector
integer = Integer(0)
list_item_2 = ListItem(List=merge, Index=integer, Wrap=True)  # -> Item, Item1, Item2
vector_2pt_2 = Vector2Pt(PointA=list_item_2.Item, PointB=list_item_2.Item2, Unitize=False)  # -> Vector, Length
point = Point(list_item_2.Item)
vector = Vector(vector_2pt_2.Vector)

# ----
# shift
move = Move(Geometry=scale.Geometry, Motion=transformed_preview_offset_vector)  # -> Geometry, Transform

transformed_geometry = Geometry(move.Geometry)
geometry = Geometry(polyline)
point_2 = Point(point)
vector_2 = Vector(vector)

# ----
# build_linkage_on_original_form
orient_direction = OrientDirection(Geometry=geometry, PointA=point_2, DirectionA=vector_2, PointB=end_points.Start, DirectionB=vector_2pt.Vector)  # -> Geometry, Transform
integer_2 = Integer(0)
list_item_3 = ListItem(List=orient_direction.Geometry, Index=integer_2, Wrap=True)
explode_3 = Explode(Curve=list_item_3, Recursive=True)  # -> Segments, Vertices
list_item_4 = ListItem(List=explode_3.Segments, Index=integer_2, Wrap=True)
length = Length(Curve=list_item_4)
first_rhombus_length = Number(length)

# ----
# construct_transformed_rhombus
explode_4 = Explode(Curve=transformed_geometry, Recursive=True)  # -> Segments, Vertices
integer_3 = Integer(0)
list_item_5 = ListItem(List=explode_4.Vertices, Index=integer_3, Wrap=True)  # -> flatten(Item), flatten(Item1)
circle_cnr = CircleCNR(Center=[list_item_5.Item, list_item_5.Item1], Normal=plane_3pt, Radius=first_rhombus_length)
list_item_6 = ListItem(List=circle_cnr, Index=0, Wrap=True)  # -> Item, Item1
curve_curve = CurveCurve(CurveA=list_item_6.Item, CurveB=list_item_6.Item1)  # -> Points, ParamsA, ParamsB
list_item_7 = ListItem(List=curve_curve.Points, Index=0, Wrap=True)  # -> flatten(Item), flatten(Item1)
merge_2 = Merge(Data1=list_item_5.Item, Data2=list_item_7.Item, Data3=list_item_5.Item1, Data4=list_item_7.Item1)  # -> flatten(Result)
boolean_2 = Boolean(True)
polyline_2 = PolyLine(Vertices=merge_2, Closed=boolean_2)

# ----
# select_rhomb_vector
integer_4 = Integer(0)
list_item_8 = ListItem(List=merge_2, Index=integer_4, Wrap=True)  # -> Item, Item1, Item2
vector_2pt_3 = Vector2Pt(PointA=list_item_8.Item, PointB=list_item_8.Item2, Unitize=False)  # -> Vector, Length
point_3 = Point(list_item_8.Item)
vector_3 = Vector(vector_2pt_3.Vector)

# ----
# generate_segments
explode_5 = Explode(Curve=transformed_geometry, Recursive=True)  # -> Segments, Vertices
end_points_2 = EndPoints(Curve=explode_5.Segments)  # -> Start, End
vector_2pt_4 = Vector2Pt(PointA=end_points_2.Start, PointB=end_points_2.End, Unitize=False)  # -> Vector, Length

# ----
# mechanism_skeleton
orient_direction_2 = OrientDirection(Geometry=polyline_2, PointA=point_3, DirectionA=vector_3, PointB=end_points_2.Start, DirectionB=vector_2pt_4.Vector)  # -> Geometry, Transform

# ----
# extract_scissor_left_right
explode_6 = Explode(Curve=orient_direction_2.Geometry, Recursive=True)  # -> Segments, Vertices
integer_5 = Integer(0)
list_item_9 = ListItem(List=explode_6.Segments, Index=integer_5, Wrap=True)  # -> flatten(Item), flatten(Item1), flatten(Item2), flatten(Item3)

# ----
# merge_edge_lists_to_links
integer_6 = Integer(-1)
boolean_3 = Boolean(True)
shift_list = ShiftList(List=list_item_9.Item2, Shift=integer_6, Wrap=boolean_3)  # -> flatten(List)
flip_matrix = FlipMatrix(Data=list_item_9.Item)
flip_matrix_2 = FlipMatrix(Data=shift_list)
join_curves = JoinCurves(Curves=[flip_matrix, flip_matrix_2], Preserve=False)

# ----
# merge_edge_lists_to_links
integer_7 = Integer(-1)
boolean_4 = Boolean(True)
shift_list_2 = ShiftList(List=list_item_9.Item1, Shift=integer_7, Wrap=boolean_4)  # -> flatten(List)
flip_matrix_3 = FlipMatrix(Data=list_item_9.Item3)
flip_matrix_4 = FlipMatrix(Data=shift_list_2)
join_curves_2 = JoinCurves(Curves=[flip_matrix_4, flip_matrix_3], Preserve=False)

# ----
# draw_physical_links
geometry_2 = Geometry(join_curves)
geometry_3 = Geometry(join_curves_2)
number = Number(link_width)
plane = Plane(plane_3pt)
number_2 = Number(hole_size)

# ----
# build_link
negative = Negative(Value=number)
integer_8 = Integer(3)
offset_curve = OffsetCurve(Curve=geometry_3, Plane=plane, Distance=number, BothSides=negative, Kinks=integer_8, CapType=integer_8)

# ----
# build_link
negative_2 = Negative(Value=number)
integer_9 = Integer(3)
offset_curve_2 = OffsetCurve(Curve=geometry_2, Plane=plane, Distance=number, BothSides=negative_2, Kinks=integer_9, CapType=integer_9)

# ----
# build_hole
explode_7 = Explode(Curve=[geometry_3, geometry_2], Recursive=True)  # -> Segments, flatten(Vertices)
circle_cnr_2 = CircleCNR(Center=explode_7.Vertices, Normal=plane, Radius=number_2)

geometry_4 = Geometry(offset_curve)
geometry_5 = Geometry(offset_curve_2)
geometry_6 = Geometry(circle_cnr_2)

# ----
# display
colour = Colour(RGB(0, 255, 255))
colour_2 = Colour(RGB(0, 255, 34))
colour_3 = Colour(RGB(225, 0, 255))
custom_preview = CustomPreview(Geometry=geometry_5, Material=colour)
custom_preview_2 = CustomPreview(Geometry=geometry_4, Material=colour_3)
custom_preview_3 = CustomPreview(Geometry=geometry_6, Material=colour_2)
